# Grasshopper definition sampleCode.gh (Grasshopper 1.0.7)
# plug-ins: topoBuilding, topoGraphy, topoROK, topoStreet, topoRiver, ScriptParasite

panel = Panel("\"C:\\Users\\BaekInchan\\Downloads\\(B010)수치지도_37608068_2024_00000165193019\"")
toposhp = TopoSHP(SHPFolder=panel)  # -> TopoLines, TopoLinesZ, BuildingLines, BuildingLinesZ, StreetLines, WaterLines, ParkPoints, ShapefileDictionary
pt = Point(toposhp.ParkPoints)
Z = UnitZ(Factor=toposhp.TopoLinesZ)
move = Move(Geometry=toposhp.TopoLines, Motion=Z)  # -> Geometry, Transform
topography = TopoGraphy(TerrainLines=toposhp.TopoLines, TerrainLinesZ=toposhp.TopoLinesZ, Resolution=Slider(5, range=0..100), Run=Toggle(True))
number_slider = Slider(100, range=0..1000)
topobuilding = TopoBuilding(
    TopoSurface=topography,
    BuildingLines=toposhp.BuildingLines,
    BuildingLinesZ=toposhp.BuildingLinesZ,
    BuildingType="parapet",
    RemoveUnderArea=Slider(50, range=0..100),
    Run=Toggle(True))
topostreet = TopoStreet(TopoSurface=topography, StreetLines=toposhp.StreetLines, Run=Toggle(True))  # -> StreetCurve, StreetFlatCurve
topowater = TopoWater(TopoSurface=topography, WaterLine=toposhp.WaterLines, Run=Toggle(True))  # -> WaterCurve, WaterFlatCurve, WaterSurface
toggle = BooleanToggle(True)  # disabled
rider = RIder(openFile=toggle)  # -> Folder; inputs openFile: Boolean; disabled
# ---------- rider: C# usings ----------
using System.IO;
using System.Diagnostics;

public class ScriptUtilities
{
  public static string GetCurrentFolder(GH_Document doc)
  {
    string filePath = doc.FilePath;
    return Path.GetDirectoryName(filePath);
  }

  public static string[] GetCsFiles(string folderPath)
  {
    return Directory.GetFiles(folderPath, "*.cs");
  }

  public static void OpenFileWithRider(string filePath, Action<string> print)
  {
    try
    {
      // Define the path to the JetBrains Rider executable
      string riderPath = @"C:\Program Files\JetBrains\JetBrains Rider 2024.1.4\bin\rider64.exe";

      if (!File.Exists(riderPath))
      {
        print("Rider executable not found at: " + riderPath);
        return;
      }

      // Start the process to open the file with Rider
      ProcessStartInfo startInfo = new ProcessStartInfo
        {
          FileName = riderPath,
          Arguments = "\"" + filePath + "\"", // Enclose in quotes in case of spaces
          UseShellExecute = true
          };
      Process.Start(startInfo);
    }
    catch (Exception ex)
    {
      print("Error opening file with Rider: " + ex.Message);
    }
  }

  public static void RunScript(bool openFile, ref object Here, IGH_Component owner, Action<string> print)
  {
    // Get the current folder path
    GH_Document doc = owner.OnPingDocument();
    string currentFolder = GetCurrentFolder(doc);
    Here = currentFolder;

    // Get .cs files in the current folder
    string[] csFiles = GetCsFiles(currentFolder);
    if (csFiles.Length > 0)
    {
      string csFilePath = csFiles[0];

      if (openFile)
      {
        OpenFileWithRider(csFilePath, print);
      }
    }
    else
    {
      print("No .cs files found in the directory.");
    }
  }
}
# ---------- rider: C# ----------
   ScriptUtilities.RunScript(openFile, ref Folder, Component, Print);
# ---------- end rider ----------

c_script = CSharpScript(x=topography, y=number_slider, scale=Slider(500, range=0..1000))  # -> out, A, B, C, D; inputs x: Surface, y: Int32, scale: Double; disabled
# ---------- c_script: C# usings ----------
using System.Collections.Concurrent;
using System.Linq;
using System.Threading.Tasks;
using Rhino.Geometry.Intersect;
# ---------- c_script: C# ----------
        var edges = x.ToBrep().Edges.ToList();
    BoundingBox bbox = x.GetBoundingBox(true);
    Point3d[] corners = bbox.GetCorners();
    Point3d maxZPoint = corners.OrderByDescending(pt => pt.Z).FirstOrDefault();
    Point3d minZPoint = corners.OrderBy(pt => pt.Z).FirstOrDefault();
    Point3d boxStPt = new Point3d(minZPoint.X, minZPoint.Y, minZPoint.Z - 100);
    Plane pl = Plane.WorldXY;
    pl.Origin = boxStPt; 
    List<Brep> breps = new List<Brep>();
    foreach (var i in edges)
    {
      Curve upCrv = i.DuplicateCurve(); 
      Curve dnCrv = Curve.ProjectToPlane(upCrv, pl);
      var sideSrf = NurbsSurface.CreateRuledSurface(upCrv, dnCrv);
      breps.Add(sideSrf.ToBrep());
    }
    var union = Brep.JoinBreps(breps, 0.01);
    Brep side = null; 
    if (union != null && union.Length > 0)
    {
      side = union[0]; 
    }
    if (side == null) return; 
    
    pl.Origin = minZPoint; 
    List<Plane> planes = new List<Plane>() { pl };
    for (int i = 0; i < 1000000; i++)
    {
      var nxtPl = new Plane(planes.Last());
      nxtPl.Origin = new Point3d(nxtPl.Origin.X, nxtPl.Origin.Y, nxtPl.Origin.Z + scale / 1000);
      if (nxtPl.Origin.Z > maxZPoint.Z)
      {
        break;
      }
      planes.Add(nxtPl);
    }

    MeshingParameters meshingParams = new MeshingParameters();
    meshingParams.RefineGrid = true;
    Brep topo = x.ToBrep();
    // var mesh = Mesh.CreateFromBrep(union[0], meshingParams); 
    var mesh2 = Mesh.CreateFromBrep(topo, meshingParams); 
    ConcurrentBag<Curve> contourCurveBag = new ConcurrentBag<Curve>();
    if (mesh2 != null && mesh2.Length > 0)
    {
      Mesh cutted = mesh2[0];
      // Mesh cutted2 = mesh[0];
      Parallel.ForEach(planes, cutter =>
      {
        var topoCutted = Mesh.CreateContourCurves(cutted, cutter, 0.01);
        if (topoCutted != null && topoCutted.Length > 0)
        {
          foreach (var curve in topoCutted)
          {
            contourCurveBag.Add(curve);
          }

          // var sideCutted = Mesh.CreateContourCurves(cutted2, cutter, 0.01);
          // if (sideCutted != null && sideCutted.Length > 0)
          // {
          //   foreach (var curve in sideCutted)
          //   {
          //     joinContour.Add(curve);
          //   }
          // }
          //
          // var joined = Curve.JoinCurves(joinContour.ToList());
          // if (joined != null && joined.Length > 0)
          // {
          //   foreach (var curve in joined)
          //   {
          //     contourCurveBag.Add(curve);
          //   }
          // }
        }
      });
    }

    A = contourCurveBag;
# ---------- end c_script ----------
scriptpar = ScriptParasite(Enable=toggle, Folder=rider)  # disabled

c_script_2 = CSharpScript(x=topography, y=number_slider)  # -> out, A, B, C; inputs x: Surface, y: Int32
# ---------- c_script_2: C# usings ----------
using System.Linq;
# ---------- c_script_2: C# ----------
    var edges = x.ToBrep().Edges.ToList();
    var pts = x.ToBrep().Vertices.ToList();
    var minZPoint = pts.OrderBy(p => p.Location.Z).FirstOrDefault();
    Point3d boxStPt = new Point3d(minZPoint.Location.X, minZPoint.Location.Y, minZPoint.Location.Z - y);
    Plane pl = Plane.WorldXY;
    pl.Origin = boxStPt; 
    List<Brep> breps = new List<Brep>() { x.ToBrep() };
    List<Curve> curves = new List<Curve>();
    foreach (var i in edges)
    {
      Curve upCrv = i.DuplicateCurve();
      Curve dnCrv = Curve.ProjectToPlane(upCrv, pl);
      var sideSrf = NurbsSurface.CreateRuledSurface(upCrv, dnCrv);
      breps.Add(sideSrf.ToBrep());
      curves.Add(dnCrv);
    }

    B = PlanarSrf(Curve.JoinCurves(curves)[0]);
    breps.Add(PlanarSrf(Curve.JoinCurves(curves)[0]));
    var union = Brep.JoinBreps(breps, 0.01);

    if (union != null && union.Length > 0)
    {
      A = union[0];
    }
# ---------- c_script_2: C# additional code ----------
  public Brep PlanarSrf(Curve c)
  {
    string log;
    Brep ret = null;
    if (c.IsValidWithLog(out log) && c.IsPlanar() && c.IsClosed)
    {
      var tmp = Brep.CreatePlanarBreps(c, 0.01);
      ret = tmp[0];
      return ret;
    }
    return ret;
  }
# ---------- end c_script_2 ----------
custom_mesh_settings = SettingsCustom(
    StitchSeams=True,
    SimplePlanes=False,
    Refine=True,
    MinCount=16,
    MaxCount=400,
    AspectRatio=20,
    MaxDistance=0,
    MaxAngle=20,
    MinEdge=0,
    MaxEdge=0)  # disabled
brep = Brep(c_script_2.A)  # disabled
number_slider_2 = Slider(1, range=0..1)  # disabled
crv = Curve(c_script.A)  # disabled
mesh = MeshBrep(Brep=brep, Settings=custom_mesh_settings)  # disabled
Z_2 = UnitZ(Factor=1)  # disabled
panel_2 = Panel(c_script.out)  # disabled
cls = Closed()  # -> Closed, Periodic; disabled
contour = Contour(Shape=mesh, Point=Point(0, 0, 0), Direction=Z_2, Distance=number_slider_2)  # -> flatten(Contours); disabled
number_slider_3 = Slider(10, range=0..100)  # disabled
Z_3 = UnitZ(Factor=number_slider_2)  # disabled
dispatch = Dispatch(DispatchPattern=cls.Closed)  # -> ListA, ListB; disabled
number_slider_4 = Slider(1000, range=0..1000)  # disabled
move_2 = Move(Geometry=contour, Motion=Z_3)  # -> Geometry, Transform; disabled
crv_2 = Curve(dispatch.ListA)  # disabled
crv_3 = Curve(dispatch.ListB)  # disabled
merge = Merge(Data1=graft(contour), Data2=graft(move_2.Geometry))  # disabled
divlength = DivideLength(Curve=crv_2, Length=number_slider_3)  # -> Points, Tangents, Parameters; disabled
divlength_2 = DivideLength(Curve=crv_3, Length=number_slider_3)  # -> Points, Tangents, Parameters; disabled
pline = PolyLine(Vertices=divlength.Points, Closed=invert(False))  # disabled
item = ListItem(List=merge, Index=0, Wrap=True)  # -> Item, Item1; disabled
pline_2 = PolyLine(Vertices=divlength_2.Points, Closed=False)  # disabled
rulesrf = RuledSurface(CurveA=item.Item, CurveB=item.Item1)  # disabled
fillet = Fillet(Curve=pline, Radius=number_slider_4)  # disabled
fillet_2 = Fillet(Curve=pline_2, Radius=number_slider_4)  # disabled
