# Grasshopper definition unnamed.gh (Grasshopper 1.0.7)
# plug-ins: atit, ScriptParasite

panel = Panel(""""C:\Users\BaekInchan\Downloads\(B010)수치지도_37608068_2024_00000165193019\N3P_H0059153.shp"
"C:\Users\BaekInchan\Downloads\(B010)수치지도_37608068_2024_00000165193019\N3A_A0010000.shp"
"C:\Users\BaekInchan\Downloads\(B010)수치지도_37608068_2024_00000165193019\N3A_A0033320.shp"
"C:\Users\BaekInchan\Downloads\(B010)수치지도_37608068_2024_00000165193019\N3A_A0053326.shp"
"C:\Users\BaekInchan\Downloads\(B010)수치지도_37608068_2024_00000165193019\N3A_A0063321.shp"
"C:\Users\BaekInchan\Downloads\(B010)수치지도_37608068_2024_00000165193019\N3A_A0070000.shp"
"C:\Users\BaekInchan\Downloads\(B010)수치지도_37608068_2024_00000165193019\N3A_A0080000.shp"
"C:\Users\BaekInchan\Downloads\(B010)수치지도_37608068_2024_00000165193019\N3A_A0090000.shp"
"C:\Users\BaekInchan\Downloads\(B010)수치지도_37608068_2024_00000165193019\N3A_A0110020.shp"
"C:\Users\BaekInchan\Downloads\(B010)수치지도_37608068_2024_00000165193019\N3A_B0010000.shp"
"C:\Users\BaekInchan\Downloads\(B010)수치지도_37608068_2024_00000165193019\N3A_C0390000.shp"
"C:\Users\BaekInchan\Downloads\(B010)수치지도_37608068_2024_00000165193019\N3A_C0423365.shp"
"C:\Users\BaekInchan\Downloads\(B010)수치지도_37608068_2024_00000165193019\N3A_C0430000.shp"
"C:\Users\BaekInchan\Downloads\(B010)수치지도_37608068_2024_00000165193019\N3A_D0010000.shp"
"C:\Users\BaekInchan\Downloads\(B010)수치지도_37608068_2024_00000165193019\N3A_E0010001.shp"
"C:\Users\BaekInchan\Downloads\(B010)수치지도_37608068_2024_00000165193019\N3A_E0032111.shp"
"C:\Users\BaekInchan\Downloads\(B010)수치지도_37608068_2024_00000165193019\N3A_E0052114.shp"
"C:\Users\BaekInchan\Downloads\(B010)수치지도_37608068_2024_00000165193019\N3A_G0010000.shp"
"C:\Users\BaekInchan\Downloads\(B010)수치지도_37608068_2024_00000165193019\N3A_G0020000.shp"
"C:\Users\BaekInchan\Downloads\(B010)수치지도_37608068_2024_00000165193019\N3A_H0010000.shp"
"C:\Users\BaekInchan\Downloads\(B010)수치지도_37608068_2024_00000165193019\N3L_A0010000.shp"
"C:\Users\BaekInchan\Downloads\(B010)수치지도_37608068_2024_00000165193019\N3L_A0020000.shp"
"C:\Users\BaekInchan\Downloads\(B010)수치지도_37608068_2024_00000165193019\N3L_A0033330.shp"
"C:\Users\BaekInchan\Downloads\(B010)수치지도_37608068_2024_00000165193019\N3L_A0123373.shp"
"C:\Users\BaekInchan\Downloads\(B010)수치지도_37608068_2024_00000165193019\N3L_B0020000.shp"
"C:\Users\BaekInchan\Downloads\(B010)수치지도_37608068_2024_00000165193019\N3L_C0050000.shp"
"C:\Users\BaekInchan\Downloads\(B010)수치지도_37608068_2024_00000165193019\N3L_C0060000.shp"
"C:\Users\BaekInchan\Downloads\(B010)수치지도_37608068_2024_00000165193019\N3L_C0070000.shp"
"C:\Users\BaekInchan\Downloads\(B010)수치지도_37608068_2024_00000165193019\N3L_C0520000.shp"
"C:\Users\BaekInchan\Downloads\(B010)수치지도_37608068_2024_00000165193019\N3L_E0020000.shp"
"C:\Users\BaekInchan\Downloads\(B010)수치지도_37608068_2024_00000165193019\N3L_F0010000.shp"
"C:\Users\BaekInchan\Downloads\(B010)수치지도_37608068_2024_00000165193019\N3L_F0030000.shp"
"C:\Users\BaekInchan\Downloads\(B010)수치지도_37608068_2024_00000165193019\N3L_F0040000.shp"
"C:\Users\BaekInchan\Downloads\(B010)수치지도_37608068_2024_00000165193019\N3L_G0030000.shp"
"C:\Users\BaekInchan\Downloads\(B010)수치지도_37608068_2024_00000165193019\N3P_C0090000.shp"
"C:\Users\BaekInchan\Downloads\(B010)수치지도_37608068_2024_00000165193019\N3P_C0285311.shp"
"C:\Users\BaekInchan\Downloads\(B010)수치지도_37608068_2024_00000165193019\N3P_C0330000.shp"
"C:\Users\BaekInchan\Downloads\(B010)수치지도_37608068_2024_00000165193019\N3P_C0340000.shp"
"C:\Users\BaekInchan\Downloads\(B010)수치지도_37608068_2024_00000165193019\N3P_C0380000.shp"
"C:\Users\BaekInchan\Downloads\(B010)수치지도_37608068_2024_00000165193019\N3P_D0030000.shp"
"C:\Users\BaekInchan\Downloads\(B010)수치지도_37608068_2024_00000165193019\N3P_E0042326.shp"
"C:\Users\BaekInchan\Downloads\(B010)수치지도_37608068_2024_00000165193019\N3P_E0072325.shp"
"C:\Users\BaekInchan\Downloads\(B010)수치지도_37608068_2024_00000165193019\N3P_F0020000.shp"
"C:\Users\BaekInchan\Downloads\(B010)수치지도_37608068_2024_00000165193019\N3P_H0020000.shp"
"C:\Users\BaekInchan\Downloads\(B010)수치지도_37608068_2024_00000165193019\N3P_H0040000.shp"
""")
python = GhPythonScript(x="N3A_B0010000", shapeFile=panel)  # -> out, a, ans; inputs shapeFile: list
# ---------- python: Python ----------
__author__ = "BaekInchan"
__version__ = "2024.03.23"

import rhinoscriptsyntax as rs


a = []

for i in shapeFile : 
    if(i[0] == '"') : i = i[1 :]
    if(i[-1] == '"') : i = i[:-1]
    #if(i.split("\\")[-1].split("_")[0][-1] == 'P') : continue; 
    a.append(i)

ans = ""

for i in a : 
    if x in i : 
        ans = i
        break
# ---------- end python ----------
python_2 = GhPythonScript(x="F0010000", shapeFile=panel)  # -> out, a, ans; inputs shapeFile: list; same code as python
toggle = BooleanToggle(True)
path = FilePath(python_2.ans)
toggle_2 = BooleanToggle(True)
imp_it = ImpIt(ShapefileShpPath=python.ans, Project2WGS84=False, TrueOrFalse=toggle)  # -> Shapes, Features
imp_it_2 = ImpIt(ShapefileShpPath=python_2.ans, Project2WGS84=False, TrueOrFalse=toggle_2)  # -> Shapes, Features
item = ListItem(List=imp_it.Features, Index=Slider(5, range=0..10), Wrap=True)
datavis_it = DataVisIt(Shapes=imp_it.Shapes, GetValueofFeature=item, TrueOrFalse=toggle)  # -> Polygon, Polyline, Point, AttValues
item_2 = ListItem(List=imp_it_2.Features, Index=Slider(1, range=0..10), Wrap=True)
datavis_it_2 = DataVisIt(Shapes=imp_it_2.Shapes, GetValueofFeature=item_2, TrueOrFalse=toggle_2)  # -> Polygon, Polyline, Point, AttValues
toggle_3 = BooleanToggle(True)
rider = RIder(openFile=toggle_3)  # -> Folder; inputs openFile: Boolean
# ---------- rider: C# usings ----------
using System.IO;
using System.Diagnostics;

public class ScriptUtilities
{
  public static string GetCurrentFolder(GH_Document doc)
  {
    string filePath = doc.FilePath;
    return Path.GetDirectoryName(filePath);
  }

  public static string[] GetCsFiles(string folderPath)
  {
    return Directory.GetFiles(folderPath, "*.cs");
  }

  public static void OpenFileWithRider(string filePath, Action<string> print)
  {
    try
    {
      // Define the path to the JetBrains Rider executable
      string riderPath = @"C:\Program Files\JetBrains\JetBrains Rider 2024.1.4\bin\rider64.exe";

      if (!File.Exists(riderPath))
      {
        print("Rider executable not found at: " + riderPath);
        return;
      }

      // Start the process to open the file with Rider
      ProcessStartInfo startInfo = new ProcessStartInfo
        {
          FileName = riderPath,
          Arguments = "\"" + filePath + "\"", // Enclose in quotes in case of spaces
          UseShellExecute = true
          };
      Process.Start(startInfo);
    }
    catch (Exception ex)
    {
      print("Error opening file with Rider: " + ex.Message);
    }
  }

  public static void RunScript(bool openFile, ref object Here, IGH_Component owner, Action<string> print)
  {
    // Get the current folder path
    GH_Document doc = owner.OnPingDocument();
    string currentFolder = GetCurrentFolder(doc);
    Here = currentFolder;

    // Get .cs files in the current folder
    string[] csFiles = GetCsFiles(currentFolder);
    if (csFiles.Length > 0)
    {
      string csFilePath = csFiles[0];

      if (openFile)
      {
        OpenFileWithRider(csFilePath, print);
      }
    }
    else
    {
      print("No .cs files found in the directory.");
    }
  }
}
# ---------- rider: C# ----------
   ScriptUtilities.RunScript(openFile, ref Folder, Component, Print);
# ---------- end rider ----------

c_script = CSharpScript(topoLine=datavis_it_2.Polyline, topoHeight=datavis_it_2.AttValues, resolution=Slider(13, range=0..100), Run=Toggle(True))  # -> out, topo3D; inputs topoLine: tree of Curve, topoHeight: tree of Double, resolution: Int32, Run: Boolean
# ---------- c_script: C# usings ----------
using System.Linq;
# ---------- c_script: C# ----------
    if (!Run) return; 

      List<List<Curve>> topoLineList = ConvertTreeToNestedList(topoLine);
      List<List<double>> topoHeightList = ConvertTreeToNestedList(topoHeight);
      List<List<Curve>> topoLineRet = new List<List<Curve>>();
      List<GeometryBase> gemoList = new List<GeometryBase>();
      List<Point3d> allDividePts = new List<Point3d>();

      for (int i = 0; i < topoLineList.Count; i++)
      {
        if (topoLineList[i] == null || topoHeightList[i] == null) continue; 
        Curve now = topoLineList[i][0];
        double height = topoHeightList[i][0];
        Point3d st = now.PointAtStart;
        Point3d en = MovePt(st, Vector3d.ZAxis, height);
        Curve nxt = MoveOrientPoint(now, st, en);
        topoLineRet.Add(new List<Curve>() { nxt });
        gemoList.Add(now);
        Point3d[] divLenPts;
        nxt.DivideByLength(10, false, out divLenPts); 
        if(divLenPts != null) allDividePts.AddRange(divLenPts);
      }

      Brep bbox = CalculateBoundingBox(gemoList).ToBrep();
      var segRectangle = bbox.Faces;
      var sortedRectangle = segRectangle.OrderBy(x => x.GetBoundingBox(false).Center.Z).ToList();
      var bottomCrv = Curve.JoinCurves(sortedRectangle[0].ToBrep().Edges)[0];
      var bottomCrvOffset = OffsetCurve(bottomCrv, Plane.WorldXY, 20);

      var findNearestCrv = bbox.Edges.Where(edge =>
        {
          Vector3d edgeDirection = edge.PointAtEnd - edge.PointAtStart;
          edgeDirection.Unitize();
          return Math.Abs(edgeDirection * Vector3d.ZAxis - 1) < RhinoMath.ZeroTolerance;
        })
        .Select(edge => edge.ToNurbsCurve())
        .ToList(); 
      
      
      
      for (int i = 0; i < findNearestCrv.Count; i++)
      {
        var now = findNearestCrv[i];
        double t;
        allDividePts.Sort((x, y) => 
        {
          now.ClosestPoint(x, out t);
          double distX = now.PointAt(t).DistanceTo(x);
    
          now.ClosestPoint(y, out t);
          double distY = now.PointAt(t).DistanceTo(y);
    
          return distX.CompareTo(distY);
        });
        now.ClosestPoint(allDividePts[0], out t);
        var nxt = now.PointAt(t);
        allDividePts.Add(nxt); 
      }
      
      var delMesh = CreateDelaunayMesh(allDividePts);
      int uCount = 0, vCount = 0;
      var ptsSrf = DivideSurface(PlanarSrf(bottomCrvOffset), resolution, ref uCount, ref vCount);
      
      List<Point3d> ptsDelMesh = new List<Point3d>();
      
      for (int i = 0; i < ptsSrf.Count; i++)
      {
        var now = ptsSrf[i]; 
        Ray3d ray = new Ray3d(new Point3d(now.X, now.Y, now.Z - 100.0), Vector3d.ZAxis);
        Point3d? intersectionPoint = MeshRay(delMesh, ray);
        if(intersectionPoint != null) ptsDelMesh.Add(intersectionPoint.Value);
      }
      var finalTopo = SurfaceFromPoints(ptsDelMesh, uCount + 1, vCount + 1);
  
      topo3D = finalTopo;
# ---------- c_script: C# additional code ----------
 public Surface SurfaceFromPoints(List<Point3d> points, int uCount, int vCount)
  {
    if (points == null || points.Count < 4)
    {
      throw new ArgumentException("At least 4 points are required to create a surface.");
    }

    if (uCount * vCount != points.Count)
    {
      throw new ArgumentException("The number of points must be equal to uCount * vCount.");
    }

    // Create a NurbsSurface from the points
    NurbsSurface surface = NurbsSurface.CreateFromPoints(points, uCount, vCount, 3, 3);

    return surface;
  }
  
  
  public static Point3d? MeshRay(Mesh mesh, Ray3d ray)
  {
    if (mesh == null || !mesh.IsValid)
    {
      return null;
    }

    // Perform ray intersection with the mesh
    int[] t;
    var intersection = Rhino.Geometry.Intersect.Intersection.MeshRay(mesh, ray, out t);

    if (intersection >= 0)
    {
      Point3d intersectionPoint = ray.PointAt(intersection);
      return intersectionPoint;
    }

    return null;
  }
  public int Gcd(int a, int b)
  {
    while (b != 0)
    {
      int temp = b;
      b = a % b;
      a = temp;
    }

    return Math.Abs(a);
  }
  public Surface PlanarSrf(Curve c)
  {
    string log;
    Surface ret = null;
    if (c.IsValidWithLog(out log) && c.IsPlanar() && c.IsClosed)
    {
      var tmp = Brep.CreatePlanarBreps(c, 0.01);
      ret = tmp[0].Faces[0];
      return ret;
    }
    return ret;
  }
  
  
  public List<Point3d> DivideSurface(Surface surface, int k, ref int uCount, ref int vCount)
  {
    List<Point3d> pointsOnSurface = new List<Point3d>();
    int ul = (int)surface.Domain(0).Length / 100 * 100;
    int vl = (int)surface.Domain(1).Length / 100 * 100; 
    int gcd = Gcd(ul, vl); 
    var candidates = GetDivisors(gcd); 
    int u = ul / candidates[Math.Min(candidates.Count - 1, k)];
    int v = vl / candidates[Math.Min(candidates.Count - 1, k)];
    Print(candidates.Count.ToString());

    double uSteps = surface.Domain(0).Length / u; 
    double vSteps = surface.Domain(1).Length / v;
    
    for (int i = 0; i < u + 1; i++)
    {
      for (int j = 0; j < v + 1; j++)
      {
        double uParam = surface.Domain(0).T0 + i * uSteps;
        double vParam = surface.Domain(1).T0 + j * vSteps;
        Point3d pt = surface.PointAt(uParam, vParam);
        pointsOnSurface.Add(pt);
      }
    }

    uCount = u;
    vCount = v;
    return pointsOnSurface;
  }


  public List<int> GetDivisors(int n)
  {
    List<int> divisors = new List<int>();

    for (int i = 1; i <= Math.Sqrt(n); i++)
    {
      if (n % i == 0)
      {
        divisors.Add(i);
        if (i != n / i)
        {
          divisors.Add(n / i);
        }
      }
    }

    divisors = divisors.Where(x => x >= 10).ToList();
    divisors.Sort((a, b) => b.CompareTo(a));
    
    return divisors;
  }
  public static Mesh CreateDelaunayMesh(List<Point3d> pts)
  {
    if (pts == null || pts.Count < 3)
    {
      return null;
    }

    // Create Node2List from points
    var nodes =new Grasshopper.Kernel.Geometry.Node2List(); 
    for (int i = 0; i < pts.Count; i++)
    {
      nodes.Append(new Grasshopper.Kernel.Geometry.Node2(pts[i].X, pts[i].Y));
    }

    // Solve Delaunay
    var faces = new List<Grasshopper.Kernel.Geometry.Delaunay.Face>();
    faces = Grasshopper.Kernel.Geometry.Delaunay.Solver.Solve_Faces(nodes, 0);
    var delMesh = Grasshopper.Kernel.Geometry.Delaunay.Solver.Solve_Mesh(nodes, 0, ref faces);

    // Update mesh vertices with original points
    for (int i = 0; i < pts.Count; i++)
    {
      delMesh.Vertices.SetVertex(i, pts[i]);
    }

    return delMesh;
  }
  
    public List<Point3d> Discontinuity(Curve x)
    {
      var seg = x.DuplicateSegments();
      List<Point3d> pts = new List<Point3d>();
      for (int i = 0; i < seg.Length; i++)
      {
        if (i == 0) pts.Add(seg[i].PointAtStart);
        pts.Add(seg[i].PointAtEnd);
      }

      if (x.IsClosed) pts.RemoveAt(pts.Count - 1);
      return pts;
    }


    public Curve OffsetCurve(Curve c, Plane p, double interval)
    {
      var seg = c.DuplicateSegments();
      var joinseg = Curve.JoinCurves(seg);
      List<Curve> outLines = new List<Curve>();
      for (int i = 0; i < joinseg.Length; i++)
      {
        outLines.AddRange(c.Offset(p, interval, 0, CurveOffsetCornerStyle.Sharp));
      }

      var ret = Curve.JoinCurves(outLines);
      return ret[0];
    }

    public static BoundingBox CalculateBoundingBox(IEnumerable < GeometryBase > geometries)
    {
      BoundingBox bbox = BoundingBox.Empty;
      foreach (var geometry in geometries)
      {
        bbox.Union(geometry.GetBoundingBox(true));
      }

      return bbox;
    }

    public Point3d MovePt(Point3d p, Vector3d v, double amp)
    {
      v.Unitize();
      Transform move = Transform.Translation(v * amp);
      p.Transform(move);
      return p;
    }

    public T MoveOrientPoint<T > (T obj, Point3d now, Point3d nxt) where T : GeometryBase
    {
      Plane baseNow = Plane.WorldXY;
      Plane st = new Plane(now, baseNow.XAxis, baseNow.YAxis);
      Plane en = new Plane(nxt, baseNow.XAxis, baseNow.YAxis);
      Transform orient = Transform.PlaneToPlane(st, en);
      obj.Transform(orient);
      return obj;
    }

    public static DataTree<T> MakeDataTree2D<T > (List < List < T >> ret)
    {
      DataTree<T> tree = new DataTree<T>();
      for (int i = 0; i < ret.Count; i++)
      {
        GH_Path path = new GH_Path(i);
        for (int j = 0; j < ret[i].Count; j++)
        {
          tree.Add(ret[i][j], path);
        }
      }

      return tree;
    }

    public List<List<T>> ConvertTreeToNestedList<T > (DataTree < T > tree)
    {
      List<List<T>> nestedList = new List<List<T>>();
      foreach (GH_Path path in tree.Paths)
      {
        List<T> subList = new List<T>(tree.Branch(path));
        nestedList.Add(subList);
      }

      return nestedList;
      ;
    }
# ---------- end c_script ----------
scriptpar = ScriptParasite(Enable=toggle_3, Folder=rider)

toggle_4 = BooleanToggle(True)
crv = Curve(datavis_it.Polygon)
srf = Surface(c_script.topo3D)
rider_2 = RIder(openFile=toggle_4)  # -> Folder; inputs openFile: Boolean; same code as rider

scriptpar_2 = ScriptParasite(Enable=toggle_4, Folder=rider_2)
c_script_2 = CSharpScript(buildingLine=crv, buildingHeight=datavis_it.AttValues, topo3D=srf, Run=Toggle(True))  # -> out, A, B, C, D; inputs buildingLine: tree of Curve, buildingHeight: tree of Double, topo3D: Surface, Run: Boolean
# ---------- c_script_2: C# usings ----------
using System.Linq;
using System.Threading;
using Rhino.Geometry.Intersect;
# ---------- c_script_2: C# ----------
    if (!Run) return; 
    List<List<Curve>> buildingLines = ConvertTreeToNestedList(buildingLine);
    List<List<double>> buildingHeights = ConvertTreeToNestedList(buildingHeight);
    
    List<List<Curve>> pureLines = new List<List<Curve>>();
    List<List<Point3d>> purePoints = new List<List<Point3d>>();
    List<List<Point3d>> nxtPurePoints = new List<List<Point3d>>();
    
    var raySrf = new List<GeometryBase>() { topo3D.ToBrep() };
    List<List<double>> pureHeights = new List<List<double>>();
    List<List<double>> deem = new List<List<double>>(); 
    List<List<Curve>> parapets = new List<List<Curve>>();
    
    
    for (int i = 0; i < buildingLines.Count; i++)
    {
      var now = buildingLines[i][0];
      var disconNow = Discontinuity(now);
      List<Point3d> rayPts = new List<Point3d>(); 
      
      foreach (var disconPts in disconNow)
      {
        Ray3d ray = new Ray3d(new Point3d(disconPts.X, disconPts.Y, disconPts.Z - 100.0), Vector3d.ZAxis); 
        var pts = Intersection.RayShoot(ray, raySrf, 1).ToList();
        if (pts.Count != 0) rayPts.Add(pts[0]); 
      }

      if (rayPts.Count != disconNow.Count) continue;
      double minDist = 1e9, maxDist = -1e9; 
      int id = -1; 
      for (int j = 0; j < rayPts.Count; j++)
      {
        var dist = rayPts[j].DistanceTo(disconNow[j]);
        if (dist < minDist)
        {
          minDist = dist;
          id = j; 
        }

        if (dist > maxDist)
        {
          maxDist = dist; 
        }
      }

      nxtPurePoints.Add(new List<Point3d>() { rayPts[id] });
      purePoints.Add(new List<Point3d>(){disconNow[id]});
      
      
  
 
      
      
      
      pureLines.Add(buildingLines[i]); 
      pureHeights.Add(buildingHeights[i]);
      deem.Add(new List<double>(){maxDist - minDist}); 
    }
    
    List<List<Curve>> moveLines = new List<List<Curve>>();
    List<List<Brep>> makeBuildings = new List<List<Brep>>();
    List<List<Brep>> makeBuildingsParapet = new List<List<Brep>>(); 
    
    for (int i = 0; i < pureLines.Count; i++)
    {
      var now = pureLines[i][0];
      Plane pl; 
      now.TryGetPlane(out pl);
      if(pl.ZAxis.Z < 0) now.Reverse();
      var nxt = MoveOrientPoint(now, purePoints[i][0], nxtPurePoints[i][0]); 
      moveLines.Add(new List<Curve>(){nxt});
      makeBuildings.Add(new List<Brep>(){Extrude(nxt, deem[i][0] + 3.5 * pureHeights[i][0]).ToBrep()});
      
      List<Brep> faces = new List<Brep>();
      Curve nxtUpper = nxt.DuplicateCurve();
      nxtUpper = MoveOrientPoint(nxtUpper, nxtPurePoints[i][0],
        MovePt(nxtPurePoints[i][0], Vector3d.ZAxis, deem[i][0] + 3.5 * pureHeights[i][0])); 
      //brep1
      faces.Add(NurbsSurface.CreateRuledSurface(nxt, nxtUpper).ToBrep());
      
      
      nxtUpper.TryGetPlane(out pl);
      var nxtUpperParapet = OffsetCurve(nxtUpper, pl, -0.3);
      if(nxtUpperParapet == null) continue;
      faces.Add(nxtUpperParapet);
      
      // Curve lowerParapet = nxtUpperParapetDepth.DuplicateCurve(); 
      // lowerParapet = MoveOrientPoint(lowerParapet, nxtUpperParapetDepth.PointAtEnd,
      //   MovePt(nxtUpperParapetDepth.PointAtEnd, -Vector3d.ZAxis, 1.3)); 
      //


      makeBuildingsParapet.Add(faces);
    }

    
    
    B = MakeDataTree2D(nxtPurePoints);
    A = MakeDataTree2D(makeBuildingsParapet);
    D = MakeDataTree2D(makeBuildings); 
    C = MakeDataTree2D(parapets);
# ---------- c_script_2: C# additional code ----------
 
  public Point3d MovePt(Point3d p, Vector3d v, double amp)
  {
    v.Unitize();
    Transform move = Transform.Translation(v * amp);
    p.Transform(move);
    return p;
  }

  public Brep PlanarSrf(Curve c)
  {
    string log;
    Brep ret = null;
    if (c.IsValidWithLog(out log) && c.IsPlanar() && c.IsClosed)
    {
      var tmp = Brep.CreatePlanarBreps(c, 0.01);
      ret = tmp[0]; 
      return ret;
    }

    return ret;
  }
  public Brep OffsetCurve(Curve c, Plane p, double interval)
  {
    var seg = c.DuplicateSegments();
    var joinseg = Curve.JoinCurves(seg);
    List<Curve> outLines = new List<Curve>();
    for (int i = 0; i < joinseg.Length; i++)
    {
      var offset = joinseg[i].Offset(p, interval, 0.001, CurveOffsetCornerStyle.Sharp);
      if (offset == null || offset.Length == 0) continue;
      outLines.AddRange(offset);
    }
    var ret = Curve.JoinCurves(outLines);
    if(ret == null || ret.Length == 0) return null;
    var boundary = PlanarSrf(c);
    var outBrep = boundary.Split(ret, 0.001).ToList();
    if(outBrep.Count == 0) return null;
    return outBrep[0];
  }
  public static Extrusion Extrude(Curve curve, double height)
  {
    Extrusion extrusion = Extrusion.Create(curve, height, true);
    return extrusion;
  }
  public List<Point3d> Discontinuity(Curve x)
  {
    var seg = x.DuplicateSegments();
    List<Point3d> pts = new List<Point3d>();
    for (int i = 0; i < seg.Length; i++)
    {
      if (i == 0) pts.Add(seg[i].PointAtStart);
      pts.Add(seg[i].PointAtEnd);
    }

    if (x.IsClosed) pts.RemoveAt(pts.Count - 1);
    return pts;
  }

  public T MoveOrientPoint<T>(T obj, Point3d now, Point3d nxt) where T : GeometryBase
  {
    Plane baseNow = Plane.WorldXY;
    Plane st = new Plane(now, baseNow.XAxis, baseNow.YAxis);
    Plane en = new Plane(nxt, baseNow.XAxis, baseNow.YAxis);
    Transform orient = Transform.PlaneToPlane(st, en);
    obj.Transform(orient);
    return obj;
  }
  public static DataTree<T> MakeDataTree2D<T>(List<List<T>> ret)
  {
    DataTree<T> tree = new DataTree<T>();
    for (int i = 0; i < ret.Count; i++)
    {
      GH_Path path = new GH_Path(i);
      for (int j = 0; j < ret[i].Count; j++)
      {

        tree.Add(ret[i][j], path);
      }
    }

    return tree;
  }
  public List<List<T>> ConvertTreeToNestedList<T>(DataTree<T> tree)
  {
    List<List<T>> nestedList = new List<List<T>>();
    foreach (GH_Path path in tree.Paths)
    {
      List<T> subList = new List<T>(tree.Branch(path));
      nestedList.Add(subList);
    }

    return nestedList;
    ;
  }
# ---------- end c_script_2 ----------

pt = Point(c_script_2.B)
crv_2 = Curve(c_script_2.C)
brep = Brep(c_script_2.A)
brep_2 = Brep(c_script_2.D)
