# Grasshopper definition 16_Divide surface.gh (Grasshopper 1.0.7)
# plug-ins: ScriptParasite

crv = Curve(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)
crv_2 = Curve(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)
planar = IsPlanar(Surface=crv, Interior=True)  # -> Planar, Plane
boundary = BoundarySurfaces(Edges=crv)
planar_2 = IsPlanar(Surface=crv_2, Interior=True)  # -> Planar, Plane
number_slider = Slider(13, range=0..100)
srf = Surface([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])
crv_3 = Curve(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)
srf_2 = Surface([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])
crv_4 = Curve(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)
bbox = BoundingBox(Content=crv, Plane=planar.Plane)  # -> Box, Box_2
number_slider_2 = Slider(23, range=0..100)
panel = Panel(crv_2)
disc = Discontinuity(Curve=crv, Level=1)  # -> Points, Parameters
bbox_2 = BoundingBox(Content=crv_2, Plane=planar_2.Plane)  # -> Box, Box_2
planar_3 = IsPlanar(Surface=crv_4, Interior=True)  # -> Planar, Plane
planar_4 = IsPlanar(Surface=srf, Interior=True)  # -> Planar, Plane
item = ListItem(List=srf_2, Index=0, Wrap=True)
planar_5 = IsPlanar(Surface=crv_3, Interior=True)  # -> Planar, Plane
boundary_2 = BoundarySurfaces(Edges=crv_4)
srf_3 = Surface(bbox.Box)
number_slider_3 = Slider(23, range=0..100)
devec = DeconstructVector(Vector=planar_4.Plane)  # -> XComponent, YComponent, ZComponent
bbox_3 = BoundingBox(Content=crv_4, Plane=planar_3.Plane)  # -> Box, Box_2
flip = Flip(Surface=srf_2, Guide=item)  # -> Surface, Result
srf_cp = SurfaceClosestPoint(Point=disc.Points, Surface=srf_3)  # -> Point, UVPoint, Distance
bbox_4 = BoundingBox(Content=crv_3, Plane=planar_5.Plane)  # -> Box, Box_2
divide = DivideDomain²(Domain=bbox_2.Box, UCount=number_slider, VCount=number_slider)
disc_2 = Discontinuity(Curve=crv_4, Level=1)  # -> Points, Parameters
area = Area(Geometry=bbox_2.Box)  # -> Area, Centroid
addition = Addition(A=devec.ZComponent, B="1")
srf_4 = Surface(bbox_3.Box)
planar_6 = IsPlanar(Surface=flip.Surface, Interior=True)  # -> Planar, Plane
srf_5 = Surface(bbox_4.Box)
iso = IsoCurve(Surface=srf_3, UVPoint=srf_cp.UVPoint)  # -> UIsocurve, VIsocurve
dispatch = Dispatch(List=srf, DispatchPattern=addition)  # -> ListA, ListB
srf_cp_2 = SurfaceClosestPoint(Point=disc_2.Points, Surface=srf_4)  # -> Point, UVPoint, Distance
pl_origin = PlaneOrigin(Base=planar_2.Plane, Origin=area.Centroid)
divide_2 = DivideDomain²(Domain=srf_5, UCount=number_slider_3, VCount=number_slider_3)
item_2 = ListItem(List=dispatch.ListA, Index=0, Wrap=True)
crv_5 = Curve(flatten([iso.VIsocurve, iso.UIsocurve]))
line = LineSDL(Start=planar_6.Plane, Direction=planar_6.Plane, Length=Slider(10, range=0..10))
subsrf = Isotrim(Surface=bbox_2.Box, Domain=divide)
srfsplit = SurfaceSplit(Surface=boundary, Curves=crv_5)
iso_2 = IsoCurve(Surface=srf_4, UVPoint=srf_cp_2.UVPoint)  # -> UIsocurve, VIsocurve
flip_2 = Flip(Surface=dispatch.ListB, Guide=dispatch.ListA)  # -> Surface, Result
subsrf_2 = Isotrim(Surface=srf_5, Domain=divide_2)
sqgrid = Square(Plane=pl_origin, Size=pl_origin, ExtentX=number_slider_2, ExtentY=number_slider_2)  # -> Cells, Points
merge = Merge(Data1=dispatch.ListA, Data2=flip_2.Surface)
crv_6 = Curve(flatten([iso_2.VIsocurve, iso_2.UIsocurve]))
project = Project(Curve=subsrf_2, Brep=crv_3, Direction=Vector(0, 0, 1))
project_2 = Project(Curve=sqgrid.Cells, Brep=crv_2, Direction=Vector(0, 0, 1))
srfsplit_2 = SurfaceSplit(Surface=boundary_2, Curves=crv_6)
disc_3 = Discontinuity(Curve=srfsplit, Level=1)  # -> Points, Parameters
edges = BrepEdges(Brep=srfsplit)  # -> Naked, Interior, NonManifold
area_2 = Area(Geometry=srfsplit)  # -> Area, Centroid
planar_7 = IsPlanar(Surface=merge, Interior=True)  # -> Planar, Plane
avr = Average(Input=disc_3.Points)
edges_2 = BrepEdges(Brep=srfsplit_2)  # -> Naked, Interior, NonManifold
disc_4 = Discontinuity(Curve=srfsplit_2, Level=1)  # -> Points, Parameters
cir = Circle(Plane=area_2.Centroid, Radius=1)  # -> graft(Circle)
midpt = CurveMiddle(Curve=edges.Naked)
line_2 = LineSDL(Start=planar_7.Plane, Direction=planar_7.Plane, Length=Slider(10, range=0..10))
item_3 = ListItem(List=edges_2.Naked, Index=0, Wrap=True)  # -> Item, Item1, Item2, Item3
item_4 = ListItem(List=disc_4.Points, Index=0, Wrap=True)  # -> Item, Item1, Item2, Item3
xy = XYPlane(Origin=avr)
alongcrv = SortAlongCurve(Points=midpt, Curve=cir)  # -> Points, Indices
number_slider_4 = Slider(0.44, range=0..1)
srf4pt = _4PointSurface(CornerA=item_4.Item, CornerB=item_4.Item1, CornerC=item_4.Item2, CornerD=item_4.Item3)  # -> flatten(Surface)
edgesrf = EdgeSurface(CurveA=item_3.Item, CurveB=item_3.Item1, CurveC=item_3.Item2, CurveD=item_3.Item3)  # -> flatten(Surface)
cir_2 = Circle(Plane=xy, Radius=Slider(5.07, range=0..10))  # -> graft(Circle)
item_5 = ListItem(List=edges.Naked, Index=alongcrv.Indices, Wrap=True)
dim = Dimensions(Surface=srf4pt)  # -> UDimension, VDimension
alongcrv_2 = SortAlongCurve(Points=disc_3.Points, Curve=cir_2)  # -> Points, Indices
item_6 = ListItem(List=item_5, Index=0, Wrap=True)  # -> Item, Item1, Item2, Item3
multiplication = Multiplication(A=dim.VDimension, B=number_slider_4)
multiplication_2 = Multiplication(A=dim.UDimension, B=number_slider_4)
item_7 = ListItem(List=alongcrv_2.Points, Index=0, Wrap=True)  # -> Item, Item1, Item2, Item3
edgesrf_2 = EdgeSurface(CurveA=item_6.Item, CurveB=item_6.Item1, CurveC=item_6.Item2, CurveD=item_6.Item3)  # -> flatten(Surface)
divide_3 = DivideDomain²(Domain=srf4pt, UCount=multiplication_2, VCount=multiplication)
srf4pt_2 = _4PointSurface(CornerA=item_7.Item, CornerB=item_7.Item1, CornerC=item_7.Item2, CornerD=item_7.Item3)  # -> flatten(Surface)
subsrf_3 = Isotrim(Surface=graft(srf4pt), Domain=divide_3)
number_slider_5 = Slider(1000, range=0..1000)
toggle = BooleanToggle(True)
rectangle = Rectangle(Plane=PlaneXY(0, 0, 0), XSize=number_slider_5, YSize=number_slider_5, Radius=0)  # -> Rectangle, Length
rider = RIder(openFile=toggle)  # -> Folder; inputs openFile: Boolean
# ---------- rider: C# usings ----------
using System.IO;
using System.Diagnostics;

public class ScriptUtilities
{
  public static string GetCurrentFolder(GH_Document doc)
  {
    string filePath = doc.FilePath;
    return Path.GetDirectoryName(filePath);
  }

  public static string[] GetCsFiles(string folderPath)
  {
    return Directory.GetFiles(folderPath, "*.cs");
  }

  public static void OpenFileWithRider(string filePath, Action<string> print)
  {
    try
    {
      // Define the path to the JetBrains Rider executable
      string riderPath = @"C:\Program Files\JetBrains\JetBrains Rider 2024.1.4\bin\rider64.exe";

      if (!File.Exists(riderPath))
      {
        print("Rider executable not found at: " + riderPath);
        return;
      }

      // Start the process to open the file with Rider
      ProcessStartInfo startInfo = new ProcessStartInfo
        {
          FileName = riderPath,
          Arguments = "\"" + filePath + "\"", // Enclose in quotes in case of spaces
          UseShellExecute = true
          };
      Process.Start(startInfo);
    }
    catch (Exception ex)
    {
      print("Error opening file with Rider: " + ex.Message);
    }
  }

  public static void RunScript(bool openFile, ref object Here, IGH_Component owner, Action<string> print)
  {
    // Get the current folder path
    GH_Document doc = owner.OnPingDocument();
    string currentFolder = GetCurrentFolder(doc);
    Here = currentFolder;

    // Get .cs files in the current folder
    string[] csFiles = GetCsFiles(currentFolder);
    if (csFiles.Length > 0)
    {
      string csFilePath = csFiles[0];

      if (openFile)
      {
        OpenFileWithRider(csFilePath, print);
      }
    }
    else
    {
      print("No .cs files found in the directory.");
    }
  }
}
# ---------- rider: C# ----------
   ScriptUtilities.RunScript(openFile, ref Folder, Component, Print);
# ---------- end rider ----------
pop2d = Populate2D(Region=rectangle.Rectangle, Count=Slider(750, range=0..1000), Seed=1)
number_slider_6 = Slider(83, range=0..1000)
pt = Point(pop2d)

scriptpar = ScriptParasite(Enable=toggle, Folder=rider)
c_script = CSharpScript(pts=pt, near=Slider(5, range=0..100), st=Slider(35, range=0..100), end=number_slider_6)  # -> out, A, B, C, D, E; inputs pts: list of Point3d, near: Int32, st: Int32, end: Int32
# ---------- c_script: C# usings ----------
using System.Linq;
# ---------- c_script: C# ----------
    
    
    
    List<Tuple<double, Point3d>>[] adj = new List<Tuple<double, Point3d>>[pts.Count];
    List<List<Curve>> li = new List<List<Curve>>();
    Dictionary<int, Point3d> dictPt = new Dictionary<int, Point3d>();
    List<Point3d> p = new List<Point3d>();
    int t = 0; 
    
    
    Print(pts.Count.ToString());
    foreach (var now in pts)
    {
      p.Add(now); 
      dictPt[t] = now; 
      List<Point3d> nxtPts = CloPts(pts, now, near); 
      List<Tuple<double, Point3d>> tmp = new List<Tuple<double, Point3d>>();
      List<Curve> tmp2 = new List<Curve>(); 
      for (int j = 0; j < nxtPts.Count; j++)
      {
        var nxtPt = nxtPts[j]; 
        double dist = now.DistanceTo(nxtPt);
        tmp.Add(Tuple.Create(dist, nxtPt));
        tmp2.Add(new Line(now, nxtPt).ToNurbsCurve());
      }

      li.Add(tmp2); 
      adj[t++] = tmp;
    }
    
    Point3d startPoint = dictPt[st];
    Point3d endPoint = dictPt[end];

    Dictionary<Point3d, Point3d> par;
    var distances = Dijkstra(adj, startPoint, pts, out par);

    // Reconstruct the shortest path from endPoint to startPoint
    List<Line> pathLines = new List<Line>();
    Point3d current = endPoint;

    while (current != startPoint)
    {
      Point3d parent = par[current];
      pathLines.Add(new Line(parent, current));
      current = parent;
    }

    // Reverse the path to go from startPoint to endPoint
    pathLines.Reverse();

    // Output the path as a list of lines
    A = pathLines;
    B = MakeDataTree2D(li);
    C = startPoint;
    D = endPoint;
    E = p;
# ---------- c_script: C# additional code ----------
  public static DataTree<T> MakeDataTree2D<T>(List<List<T>> ret)
  {
    DataTree<T> tree = new DataTree<T>();
    for (int i = 0; i < ret.Count; i++)
    {
      GH_Path path = new GH_Path(i);
      for (int j = 0; j < ret[i].Count; j++)
      {

        tree.Add(ret[i][j], path);
      }
    }

    return tree;
  }
  public List<Point3d> CloPts(List<Point3d> pts, Point3d now, int cnt)
  {
    pts.Sort((u, v) => u.DistanceTo(now).CompareTo(v.DistanceTo(now)));
    List<Point3d> ans = new List<Point3d>();

    for (int i = 0; i < pts.Count; i++)
    {
      if (ans.Count == cnt) break;
      if (pts[i] == now) continue;
      ans.Add(pts[i]);
    }

    return ans;
  }
  
  public Dictionary<Point3d, double> Dijkstra(List<Tuple<double, Point3d>>[] adj, Point3d p, List<Point3d> pts, out Dictionary<Point3d, Point3d> par)
    {
        Dictionary<Point3d, double> dist = new Dictionary<Point3d, double>();
        par = new Dictionary<Point3d, Point3d>();
        for (int i = 0; i < pts.Count; i++)
        {
            dist[pts[i]] = double.MaxValue; // Initialize all distances as infinity
            par[pts[i]] = Point3d.Unset; // Initialize the parent as an unset point
        }
        dist[p] = 0; // Distance to the source is 0
        par[p] = p; // The parent of the start node is itself
        var pq = new SortedSet<Tuple<double, Point3d>>(Comparer<Tuple<double, Point3d>>.Create((a, b) =>
        {
            int result = a.Item1.CompareTo(b.Item1);
            return result == 0 ? a.Item2.GetHashCode().CompareTo(b.Item2.GetHashCode()) : result;
        }));
        pq.Add(Tuple.Create(0.0, p));

        // Main loop of Dijkstra's algorithm
        while (pq.Count > 0)
        {
            var current = pq.Min;
            pq.Remove(current);

            double currentDist = current.Item1;
            Point3d currentPoint = current.Item2;

            // Get the index of the current point
            int currentIndex = pts.IndexOf(currentPoint);

            // Explore each neighbor of the current point
            foreach (var neighbor in adj[currentIndex])
            {
                double edgeDist = neighbor.Item1;
                Point3d neighborPoint = neighbor.Item2;

                // Calculate the potential new shortest distance
                double newDist = currentDist + edgeDist;

                // If the new distance is shorter, update and enqueue the neighbor
                if (newDist < dist[neighborPoint])
                {
                    pq.Remove(Tuple.Create(dist[neighborPoint], neighborPoint));
                    dist[neighborPoint] = newDist;
                    par[neighborPoint] = currentPoint; // Update the parent to the current point
                    pq.Add(Tuple.Create(newDist, neighborPoint));
                }
            }
        }

        // Return the dictionary of shortest distances to each point
        return dist;
    }
# ---------- end c_script ----------

number_slider_7 = Slider(154, range=0..1000)
panel_2 = Panel(c_script.out)
crv_7 = Curve(c_script.A)
crv_8 = Curve(c_script.B)
tstat = TreeStatistics(Tree=c_script.A)  # -> Paths, Length, Count
pt_2 = Point(c_script.E)
item_8 = ListItem(List=tstat.Paths, Index=number_slider_6, Wrap=True)
pt_3 = Point(c_script.C)
pt_4 = Point(c_script.D)
branch = TreeBranch(Tree=c_script.A, Path=item_8, MaintainPaths=True)
