# Grasshopper definition 17_line to surface.gh (Grasshopper 1.0.7)
# plug-ins: Anemone, ScriptParasite

crv = Curve([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])
srf = Surface(<surface referenced from the Rhino model>)
crv_2 = Curve([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])
toggle = BooleanToggle(True)
crv_3 = Curve([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])
# 3 Level - 09
boundary = BoundarySurfaces(Edges=crv)
crv_4 = Curve([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])
popgeo = PopulateGeometry(Geometry=srf, Count=Slider(200, range=0..1000), Seed=1)
midpt = CurveMiddle(Curve=crv_3)
midpt_2 = CurveMiddle(Curve=crv_4)
boundary_2 = BoundarySurfaces(Edges=crv_2)
boundary_3 = BoundarySurfaces(Edges=crv_3)
rider = RIder(openFile=toggle)  # -> Folder; inputs openFile: Boolean
# ---------- rider: C# usings ----------
using System.IO;
using System.Diagnostics;

public class ScriptUtilities
{
  public static string GetCurrentFolder(GH_Document doc)
  {
    string filePath = doc.FilePath;
    return Path.GetDirectoryName(filePath);
  }

  public static string[] GetCsFiles(string folderPath)
  {
    return Directory.GetFiles(folderPath, "*.cs");
  }

  public static void OpenFileWithRider(string filePath, Action<string> print)
  {
    try
    {
      // Define the path to the JetBrains Rider executable
      string riderPath = @"C:\Program Files\JetBrains\JetBrains Rider 2024.1.4\bin\rider64.exe";

      if (!File.Exists(riderPath))
      {
        print("Rider executable not found at: " + riderPath);
        return;
      }

      // Start the process to open the file with Rider
      ProcessStartInfo startInfo = new ProcessStartInfo
        {
          FileName = riderPath,
          Arguments = "\"" + filePath + "\"", // Enclose in quotes in case of spaces
          UseShellExecute = true
          };
      Process.Start(startInfo);
    }
    catch (Exception ex)
    {
      print("Error opening file with Rider: " + ex.Message);
    }
  }

  public static void RunScript(bool openFile, ref object Here, IGH_Component owner, Action<string> print)
  {
    // Get the current folder path
    GH_Document doc = owner.OnPingDocument();
    string currentFolder = GetCurrentFolder(doc);
    Here = currentFolder;

    // Get .cs files in the current folder
    string[] csFiles = GetCsFiles(currentFolder);
    if (csFiles.Length > 0)
    {
      string csFilePath = csFiles[0];

      if (openFile)
      {
        OpenFileWithRider(csFilePath, print);
      }
    }
    else
    {
      print("No .cs files found in the directory.");
    }
  }
}
# ---------- rider: C# ----------
   ScriptUtilities.RunScript(openFile, ref Folder, Component, Print);
# ---------- end rider ----------
planar = IsPlanar(Surface=boundary, Interior=True)  # -> Planar, Plane
hull = ConvexHull(Points=midpt, Plane=PlaneXY(0, 0, 0))  # -> Hull, HullZ, Indices
pdecon = Deconstruct(Point=midpt_2)  # -> XComponent, YComponent, ZComponent
debrep = DeconstructBrep(Brep=boundary_2)  # -> Faces, Edges, Vertices
explode = Explode(Curve=boundary_3, Recursive=True)  # -> Segments, Vertices
pt = Point(popgeo)
rec = DataRecorder("1", DataLimit=-10, RecordData=True)
trigger = Trigger(Interval=200, TimerInterval=200, Target=rec)
area = Area(Geometry=boundary)  # -> Area, Centroid
sort = SortList(Keys=pdecon.YComponent, ValuesA=crv_4)  # -> Keys, ValuesA
deplane = DeconstructPlane(Plane=planar.Plane)  # -> Origin, XAxis, YAxis, ZAxis
disc = Discontinuity(Curve=hull.Hull, Level=1)  # -> Points, Parameters

c_script = CSharpScript(pts=pt)  # -> out, A, B; inputs pts: list of Point3d
# ---------- c_script: C# ----------
    List<List<Point3d>> debug = new List<List<Point3d>>(); 
    var convex = ConvexHull2D(pts, ref debug);
    A = convex;
    B = MakeDataTree2D(debug);
# ---------- c_script: C# additional code ----------
  public List<Point3d> ConvexHull2D(List<Point3d> pts, ref List<List<Point3d>> debug)
  {
    if (pts.Count <= 1)
    {
      return pts;
    }

    pts.Sort((a, b) => a.X == b.X ? a.Y.CompareTo(b.Y) : a.X.CompareTo(b.X));

    List<Point3d> hull = new List<Point3d>(pts.Count + 1);
    int s = 0, t = 0;
    // Build lower hull
    foreach (var p in pts)
    {
      while (t >= s + 2 && CrossProduct(hull[t - 2], hull[t - 1], p) <= 0)
        t--;
      if (hull.Count > t)
        hull[t] = p;
      else
        hull.Add(p);
      t++;
      List<Point3d> tmp = new List<Point3d>();
      for (int i = 0; i < t; i++)
      {
        tmp.Add(hull[i]); 
      }
      if(tmp.Count > 0) debug.Add(tmp); 
    }
    s = --t;
    pts.Reverse();
    // Build upper hull
    foreach (var p in pts)
    {
      while (t >= s + 2 && CrossProduct(hull[t - 2], hull[t - 1], p) <= 0)
        t--;
      if (hull.Count > t)
        hull[t] = p;
      else
        hull.Add(p);
      t++;
      List<Point3d> tmp = new List<Point3d>();
      for (int i = 0; i < t; i++)
      {
        tmp.Add(hull[i]); 
      } 
      if(tmp.Count > 0) debug.Add(tmp); 
    }
    return hull.GetRange(0, t - 1 - (t == 2 && hull[0].Equals(hull[1]) ? 1 : 0));
  }
  
  // Function to compute the cross product of vectors (b - a) and (c - a)
  private double CrossProduct(Point3d a, Point3d b, Point3d c)
  {
    return (b.X - a.X) * (c.Y - a.Y) - (b.Y - a.Y) * (c.X - a.X);
  }

  public static DataTree<T> MakeDataTree2D<T>(List<List<T>> ret)
  {
    DataTree<T> tree = new DataTree<T>();
    for (int i = 0; i < ret.Count; i++)
    {
      GH_Path path = new GH_Path(i);
      for (int j = 0; j < ret[i].Count; j++)
      {

        tree.Add(ret[i][j], path);
      }
    }

    return tree;
  }
# ---------- end c_script ----------
scriptpar = ScriptParasite(Enable=toggle, Folder=rider)

hull_2 = ConvexHull(Points=explode.Vertices, Plane=PlaneXY(0, 0, 0))  # -> Hull, HullZ, Indices
item = ListItem(List=sort.ValuesA, Index=0, Wrap=True)
fline = FitLine(Points=explode.Vertices)
len = Length(Curve=boundary)  # -> expr("x / 4", Length)
ma = MassAddition(Input=[deplane.XAxis, deplane.YAxis])  # -> Result, PartialResults
pline = PolyLine(Vertices=disc.Points, Closed=False)
lng = ListLength(List=rec)
series = Series(Start=Slider(0, range=0..100), Step=Slider(90, range=0..100), Count=Slider(4, range=0..4))
simplify = SimplifyCurve(Curve=hull_2.Hull)  # -> Curve, Simplified
explode_2 = Explode(Curve=simplify.Curve, Recursive=True)  # -> Segments, Vertices
tstat = TreeStatistics(Tree=c_script.B)  # -> Paths, Length, Count
dprod = DotProduct(VectorA=sort.ValuesA, VectorB=item, Unitize=False)
colom = CollisionOneMany(Collider=explode_2.Segments, Obstacles=fline)  # -> Collision, Index
explode_3 = Explode(Curve=pline, Recursive=True)  # -> Segments, Vertices
explode_4 = Explode(Curve=simplify.Curve, Recursive=True)  # -> Segments, Vertices
amp = Amplitude(Vector=ma.Result, Amplitude=len)
cp = ControlPoints(Curve=simplify.Curve)  # -> Points, Weights, Knots
Z = UnitZ(Factor=1)
larger = LargerThan(FirstNumber=dprod, SecondNumber="0.5")  # -> LargerThan, OrEqualTo
item_2 = ListItem(List=tstat.Paths, Index=lng, Wrap=True)
midpt_3 = CurveMiddle(Curve=explode_3.Segments)
cull = CullPattern(List=explode_2.Segments, CullPattern=colom.Collision)
midpt_4 = CurveMiddle(Curve=explode_4.Segments)
dispatch = Dispatch(List=sort.ValuesA, DispatchPattern=larger.LargerThan)  # -> ListA, ListB
crv_cp = CurveClosestPoint(Point=cp.Points, Curve=simplify.Curve)  # -> Point, Parameter, Distance
vrot = Rotate(Vector=amp, Axis=Z, Angle=degrees(series))
midpt_5 = CurveMiddle(Curve=cull)
pdecon_2 = Deconstruct(Point=midpt_3)  # -> XComponent, YComponent, ZComponent
branch = TreeBranch(Tree=c_script.B, Path=item_2, MaintainPaths=True)
pdecon_3 = Deconstruct(Point=midpt_4)  # -> XComponent, YComponent, ZComponent
entwine = Entwine(Branch00=dispatch.ListA, Branch01=dispatch.ListB, FlattenInputs=True)
cull_i = CullIndex(List=crv_cp.Parameter, Indices="0", Wrap=True)
sort_2 = SortList(Keys=pdecon_2.YComponent, ValuesA=explode_3.Segments)  # -> Keys, reverse(ValuesA)
pdecon_4 = Deconstruct(Point=midpt_5)  # -> XComponent, YComponent, ZComponent
pt_2 = Point(branch)
sort_3 = SortList(Keys=pdecon_3.YComponent, ValuesA=explode_4.Segments)  # -> Keys, reverse(ValuesA)
move = Move(Geometry=area.Centroid, Motion=vrot)  # -> Geometry, Transform
item_3 = ListItem(List=cull_i, Index=0, Wrap=True)
join = JoinCurves(Curves=entwine, Preserve=False)
sort_4 = SortList(Keys=pdecon_4.YComponent, ValuesA=cull)  # -> Keys, reverse(ValuesA)
item_4 = ListItem(List=sort_2.ValuesA, Index=0, Wrap=True)
points = PointList(Points=pt_2, Size=Slider(21.1, range=0..100))
pline_2 = PolyLine(Vertices=pt_2, Closed=False)
item_5 = ListItem(List=sort_3.ValuesA, Index="1", Wrap=True)
item_6 = ListItem(List=move.Geometry, Index=Slider(4, range=0..4), Wrap=True)
midpt_6 = CurveMiddle(Curve=join)
seam = Seam(Curve=simplify.Curve, Seam=item_3)
item_7 = ListItem(List=sort_4.ValuesA, Index=0, Wrap=True)
pdecon_5 = Deconstruct(Point=midpt_6)  # -> XComponent, YComponent, ZComponent
end = EndPoints(Curve=seam)  # -> Start, End
simplify_2 = SimplifyCurve(Curve=seam)  # -> Curve, Simplified
midpt_7 = CurveMiddle(Curve=crv)  # -> graft(Midpoint)
sort_5 = SortList(Keys=pdecon_5.YComponent, ValuesA=join)  # -> Keys, ValuesA
explode_5 = Explode(Curve=simplify_2.Curve, Recursive=True)  # -> Segments, Vertices
loop_start = LoopStart(Repeat=Slider(10, range=0..10), Trigger=Toggle(False), Data=midpt_7)  # -> port, Counter, Data
ln = Line(StartPoint=midpt_7, EndPoint=item_6)
shift = ShiftList(List=sort_5.ValuesA, Shift=1, Wrap=invert(True))
lng_2 = ListLength(List=explode_5.Segments)
len_2 = Length(Curve=explode_5.Segments)
panel = Panel("""0
1""")
colom_2 = CollisionOneMany(Collider=ln, Obstacles=crv)  # -> Collision, Index
short = ShortestList(ListA=sort_5.ValuesA, ListB=shift, TrimMode=2)  # -> ListA, ListB
sort_6 = SortList(Keys=len_2, ValuesA=explode_5.Segments)  # -> Keys, ValuesA
repeat = RepeatData(Data=graft(panel), Length=expr("x / 2", lng_2))  # -> flatten(Data)
tweencrv = TweenCurve(CurveA=graft(short.ListA), CurveB=graft(short.ListB), Factor=0.5, BlendType=0)  # -> flatten(Tween)
cull_2 = CullPattern(List=sort_6.ValuesA, CullPattern=repeat)
ext = ExtendCurve(Curve=tweencrv, Type=0, Start="-1", End="-1")
loop_end = LoopEnd(port=loop_start.port, Exit=False, TimeOutVal=0, pausedState=False, state="Constant output")
item_8 = ListItem(List=cull_2, Index=Slider(0, range=0..4), Wrap=True)  # -> flatten(Item)
mcx = MultipleCurves(Curves=ext)  # -> Points, IndexA, IndexB, ParamA, ParamB
midpt_8 = CurveMiddle(Curve=crv_3)
divide = DivideCurve(Curve=crv_3, Count="1", Kinks=False)  # -> flatten(Points), Tangents, Parameters
cps = ClosestPoints(Point=mcx.Points, Cloud=midpt_2, Count="4")  # -> ClosestPoint, CPIndex, Distance
cir = Circle(Plane=mcx.Points, Radius=1)
crv_cp_2 = CurveClosestPoint(Point=midpt_8, Curve=item_8)  # -> Point, Parameter, Distance
panel_2 = Panel("Collide")
alongcrv = SortAlongCurve(Points=cps.ClosestPoint, Curve=graft(cir))  # -> Points, Indices
sort_7 = SortList(Keys=crv_cp_2.Distance, ValuesA=crv_3)  # -> Keys, ValuesA
crv_cp_3 = CurveClosestPoint(Point=divide.Points, Curve=item_8)  # -> Point, Parameter, Distance
item_9 = ListItem(List=cps.CPIndex, Index=alongcrv.Indices, Wrap=True)
bool = Boolean(crv_cp_3.Distance)
item_10 = ListItem(List=crv_4, Index=item_9, Wrap=True)
cull_3 = CullPattern(List=crv_cp_3.Point, CullPattern=invert(bool))
lng_3 = ListLength(List=cull_3)
item_11 = ListItem(List=item_10, Index=0, Wrap=True)  # -> Item, Item1, Item2, Item3
partition = PartitionList(List=sort_7.ValuesA, Size=lng_3)
edgesrf = EdgeSurface(CurveA=item_11.Item, CurveB=item_11.Item1, CurveC=item_11.Item2, CurveD=item_11.Item3)  # -> flatten(Surface)
tstat_2 = TreeStatistics(Tree=partition)  # -> Paths, Length, Count
dispatch_2 = Dispatch(List=tstat_2.Paths, DispatchPattern=[True, False])  # -> ListA, ListB
branch_2 = TreeBranch(Tree=partition, Path=dispatch_2.ListA, MaintainPaths=True)
branch_3 = TreeBranch(Tree=partition, Path=dispatch_2.ListB, MaintainPaths=True)
join_2 = JoinCurves(Curves=branch_2, Preserve=False)
join_3 = JoinCurves(Curves=branch_3, Preserve=False)
