# Grasshopper definition 21_Draw a zigzag polygon centered around a reference circle.gh (Grasshopper 1.0.7)

# 3 Level - 13
xy = XYPlane(Origin=Point(0, 0, 0))
number_slider = Slider(50, range=0..50)
prot = RotatePlane(Plane=xy, Angle="-0.5*pi")
number_slider_2 = Slider(2, range=0..10)
xy_2 = XYPlane(Origin=Point(0, 0, 0))
cir = Circle(Plane=prot, Radius=Slider(11, range=0..20))
number_slider_3 = Slider(44, range=0..50)
xy_3 = XYPlane(Origin=Point(0, 0, 0))
number_slider_4 = Slider(20, range=0..100)
prot_2 = RotatePlane(Plane=xy_2, Angle="-0.5*pi")
range = Range(Domain=Domain(0, 1), Steps=expr("x / 2 - 1", number_slider))

division = Division(A=number_slider_3, B="2")
range_2 = Range(Domain="1 to 3", Steps=division)  # -> flatten(Range)
panel = Panel("""0
-1""")
cull_i = CullIndex(List=range_2, Indices=panel, Wrap=True)  # -> reverse(List)
merge = Merge(Data1=range_2, Data2=flatten(cull_i))

divide = DivideCurve(Curve=cir, Count=number_slider, Kinks=False)  # -> Points, Tangents, Parameters
X = UnitX(Factor=expr("x*2", number_slider_2))
cir_2 = Circle(Plane=xy_3, Radius=number_slider_2)
cir_3 = Circle(Plane=prot_2, Radius=Slider(20, range=0..20))
merge_2 = Merge(Data1=Slider(3, range=0..10), Data2=Slider(1, range=0..10))
number_slider_5 = Slider(3, range=0..10)
graph = GraphMapper(range, x0=0, x1=1, y0=0, y1=1, Ox=0.4900729358, Oy=0, Px=0.75, Py=0.25, container_name="Parabola")
frame = CurveFrame(Curve=cir, Parameter=divide.Parameters)
divide_2 = DivideCurve(Curve=cir_3, Count=number_slider_3, Kinks=False)  # -> Points, Tangents, Parameters
arrlinear = LinearArray(Geometry=cir_2, Direction=X, Count=number_slider_4)  # -> Geometry, Transform
repeat = RepeatData(Data=merge_2, Length=number_slider_4)
dom = ConstructDomain(DomainStart=Slider(3, range=0..10), DomainEnd=Slider(1, range=0..10))
dispatch = Dispatch(List=frame, DispatchPattern=[True, False])  # -> ListA, ListB
dispatch_2 = Dispatch(List=divide.Points, DispatchPattern=[True, False])  # -> ListA, ListB
hframe = HorizontalFrame(Curve=cir_3, Parameter=divide_2.Parameters)
panel_2 = Panel("""1
-1""")
bnd = Bounds(Numbers=graph)
Z = UnitZ(Factor=repeat)
entwine = Entwine(Branch00=dispatch.ListA, Branch01=dispatch.ListB, FlattenInputs=True)
entwine_2 = Entwine(Branch00=dispatch_2.ListA, Branch01=dispatch_2.ListB, FlattenInputs=True)
deplane = DeconstructPlane(Plane=hframe)  # -> Origin, XAxis, YAxis, ZAxis
repeat_2 = RepeatData(Data=panel_2, Length=number_slider_3)
extr = Extrude(Base=arrlinear.Geometry, Direction=Z)
remap = RemapNumbers(Value=graph, Source=bnd, Target=dom)  # -> Mapped, Clipped
deplane_2 = DeconstructPlane(Plane=entwine)  # -> Origin, XAxis, YAxis, ZAxis
cap = CapHoles(Brep=extr)
neg = Negative(Value=remap.Mapped)
multiplication = Multiplication(A=repeat_2, B=merge)
amp = Amplitude(Vector=deplane.YAxis, Amplitude=multiplication)
entwine_3 = Entwine(Branch00=remap.Mapped, Branch01=neg, FlattenInputs=True)
amp_2 = Amplitude(Vector=deplane_2.YAxis, Amplitude=expr("x / 2", entwine_3))
move = Move(Geometry=deplane.Origin, Motion=amp)  # -> Geometry, Transform
move_2 = Move(Geometry=entwine_2, Motion=amp_2)  # -> flatten(Geometry), Transform
pline = PolyLine(Vertices=move.Geometry, Closed=invert(False))
move_3 = Move(Geometry=entwine_2, Motion=amp_2)  # -> simplify(Geometry), Transform
avr = Average(Input=move_2.Geometry)
bang = ExplodeTree(Data=move_3.Geometry)  # -> Branch0, Branch1
cir_4 = Circle(Plane=avr, Radius=1)
weave = Weave(Pattern=[0, 1], Stream0=bang.Branch0, Stream1=bang.Branch1, NullGaps=False)
alongcrv = SortAlongCurve(Points=move_2.Geometry, Curve=cir_4)  # -> Points, Indices
pline_2 = PolyLine(Vertices=weave, Closed=invert(False))
pline_3 = PolyLine(Vertices=alongcrv.Points, Closed=invert(False))
c_script = CSharpScript(sz=Slider(16, range=0..100), cnt=Slider(31, range=0..100), x=Slider(6.1, range=0..100), y=Slider(2, range=0..100))  # -> out, A, B; inputs sz: Int32, cnt: Int32, x: Double, y: Double
# ---------- c_script: C# ----------
    Curve cir = new Circle(Point3d.Origin, sz).ToNurbsCurve();
    List<Plane> pl = HorizontalPlanes(cir, cnt * 2, true);
    List<Point3d> plOrigin = new List<Point3d>();
    

    var interval = RangeInterval(x, y, (cnt + 1) / 2);
    var reverseInterval = new List<double>(interval);
    reverseInterval.Reverse();
    if((cnt & 1) == 1) interval.RemoveAt(interval.Count  - 1);
    interval.AddRange(reverseInterval); 
    
    
    for (int i = 0; i < pl.Count; i++)
    {
      var now = pl[i].Origin;
      if ((i & 1) == 1) 
      {
        var nxt = MovePt(now, pl[i].YAxis, interval[i / 2]);
        now = nxt;
      }
      plOrigin.Add(now);
    }

    
    
    B = interval; 
    A = plOrigin;
# ---------- c_script: C# additional code ----------
  public Point3d MovePt(Point3d p, Vector3d v, double amp)
  {
    v.Unitize();
    Transform move = Transform.Translation(v * amp);
    p.Transform(move);
    return p;
  }
  
  public T MoveOrientPoint<T>(T obj, Point3d now, Point3d nxt) where T : GeometryBase
  {
    Plane baseNow = Plane.WorldXY;
    Plane st = new Plane(now, baseNow.XAxis, baseNow.YAxis);
    Plane en = new Plane(nxt, baseNow.XAxis, baseNow.YAxis);
    Transform orient = Transform.PlaneToPlane(st, en);
    obj.Transform(orient);
    return obj;
  }

  public static List<double> RangeInterval(double x, double y, int cnt)
  {
    List<double> amp = new List<double>();
    if (cnt == 1) return amp;
    double gap = (y - x) / (cnt - 1);
    for (int i = 0; i < cnt; i++)
    {
      amp.Add(x + gap * i);
    }

    return amp;
  }
  
  
  public static List<Point3d> DividePts(Curve crv, int cnt, bool end)
  {
    List<Point3d> ret = new List<Point3d>();
    var crvT = crv.DivideByCount(cnt, end);
    for (int i = 0; i < crvT.Length; i++)
    {
      var pt = crv.PointAt(crvT[i]);
      ret.Add(pt);
    }

    return ret;
  }

  public static List<Plane> HorizontalPlanes(Curve x, int cnt, bool end)
  {
    var t = x.DivideByCount(cnt, end);
    List<Plane> li = new List<Plane>();
    for (int i = 0; i < t.Length; i++)
    {
      var tan = x.TangentAt(t[i]);
      Plane p = new Plane(x.PointAt(t[i]), tan, Vector3d.CrossProduct(Vector3d.ZAxis, tan));
      li.Add(p);
    }

    return li;
  }
# ---------- end c_script ----------
pline_4 = PolyLine(Vertices=c_script.A, Closed=invert(False))
boundary = BoundarySurfaces(Edges=pline_4)
