# Grasshopper definition 22_Convert a Mesh object to a Nurbs Surface.gh (Grasshopper 1.0.7)
# plug-ins: Human

mesh = Mesh(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)
mesh_2 = Mesh(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)
number_slider = Slider(20, range=0..100)
mesh_3 = Mesh(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)
# 3 Level - 14
bbox = BoundingBox(Content=mesh, Plane=PlaneXY(0, 0, 0))  # -> Box, Box_2
number_slider_2 = Slider(4, range=0..10)
demesh = DeconstructMesh(Mesh=mesh_3)  # -> Vertices, Faces, Colours, Normals
medges = MeshEdges(Mesh=mesh_2)  # -> NakedEdges, InteriorEdges, NonManifoldEdges
xy = XYPlane(Origin=Point(0, 0, 0))
pt = Point(Point(-8, -47, 0))
pt_2 = Point([Point(-3, -25, 0), Point(0, -25, 0), Point(3, -25, 0), Point(6, -25, 0), Point(-3, -23, 0), Point(0, -23, 0), Point(3, -23, 0), Point(6, -23, 0), Point(-3, -21, 0), Point(0, -21, 0), Point(3, -21, 0), Point(6, -21, 0)])
debrep = DeconstructBrep(Brep=bbox.Box)  # -> Faces, Edges, Vertices
crv = Curve([medges.NakedEdges, medges.InteriorEdges])

xy_2 = XYPlane(Origin=Point(0, 0, 0))
project = Project(Geometry=crv, Plane=xy_2)  # -> Geometry, Transform
vec = Vector(project.Geometry)
# deconstruct mesh in project plane
item = ListItem(List=vec, Index=0, Wrap=True)
dprod = DotProduct(VectorA=vec, VectorB=item, Unitize=invert(False))
abs = Absolute(Value=dprod)
expression = Expression(x=abs, Expression="round(x,1)")
panel = Panel("""0
1""")
txt = Text(expression)
txt_2 = Text(panel)
mindex = MemberIndex(Set=txt, Member=txt_2)  # -> Index, Count

planesrf = PlaneSurface(Plane=pt, XSize=number_slider, YSize=number_slider)
project_2 = Project(Geometry=demesh.Vertices, Plane=xy)  # -> Geometry, Transform
panel_2 = Panel("""0
1""")
points = PointList(Points=pt_2, Size=Slider(0.55, range=0..2))
item_2 = ListItem(List=project_2.Geometry, Index=panel_2, Wrap=True)
area = Area(Geometry=debrep.Faces)  # -> Area, Centroid
srfgrid = SurfaceFromPoints(Points=pt_2, UCount=Slider(3, range=0..10), Interpolate=False)
sdivide = DivideSurface(Surface=planesrf, UCount=number_slider_2, VCount=number_slider_2)  # -> flatten(Points), Normals, Parameters
pline = PolyLine(Vertices=item_2, Closed=False)
pdecon = Deconstruct(Point=area.Centroid)  # -> XComponent, YComponent, ZComponent
avr = Average(Input=flatten(sdivide.Points))
Z = UnitZ(Factor=Slider(20, range=0..20))
pl = ConstructPlane(Origin=Point(0, 0, 0), XAxis=pline, YAxis=Vector(0, 1, 0))
sort = SortList(Keys=pdecon.ZComponent, ValuesA=debrep.Faces)  # -> Keys, ValuesA
number_slider_3 = Slider(30, range=0..100)
move = Move(Geometry=avr, Motion=Z)  # -> Geometry, Transform
bbox_2 = BoundingBox(Content=project_2.Geometry, Plane=pl, UnionBox=True)  # -> Box, Box_2
item_3 = ListItem(List=sort.ValuesA, Index=0, Wrap=True)
replace = ReplaceMembers(Set=sdivide.Points, Find=avr, Replace=move.Geometry)
rec = Rectangle(bbox_2.Box)
sdivide_2 = DivideSurface(Surface=item_3, UCount=number_slider_3, VCount=number_slider_3)  # -> flatten(Points), Normals, Parameters
explode = Explode(Curve=rec, Recursive=True)  # -> Segments, Vertices
srfgrid_2 = SurfaceFromPoints(Points=replace, UCount=expr("x+1", number_slider_2), Interpolate=False)
Z_2 = UnitZ(Factor=1)
item_4 = ListItem(List=explode.Segments, Index=0, Wrap=True)
meshray = MeshRay(Mesh=mesh, Point=sdivide_2.Points, Direction=Z_2)  # -> Point, Hit
previewmat = CustomPreviewMaterials(Geometry=srfgrid_2, DiffuseColor=RGB(255, 255, 255))
crv_cp = CurveClosestPoint(Point=project_2.Geometry, Curve=item_4)  # -> Point, Parameter, Distance
srfgrid_3 = SurfaceFromPoints(Points=meshray.Point, UCount=expr("x + 1", number_slider_3), Interpolate=False)
expression_2 = Expression(x=crv_cp.Distance, Expression="round(x,1)")
item_5 = ListItem(List=crv, Index=mindex.Index, Wrap=True)  # -> simplify(Item)
join = JoinCurves(Curves=item_5, Preserve=False)  # -> simplify(Curves)
sort_2 = SortList(Keys=expression_2, ValuesA=demesh.Vertices)  # -> Keys, ValuesA
cset = CreateSet(List=sort_2.Keys)  # -> Set, Map
disc = Discontinuity(Curve=join, Level=1)  # -> Points, Parameters
intcrv = Interpolate(Vertices=disc.Points, Degree=3, Periodic=False, KnotStyle=1)  # -> Curve, Length, Domain
mindex_2 = MemberIndex(Set=sort_2.Keys, Member=cset.Set)  # -> Index, Count
pshift = ShiftPaths(Data=intcrv.Curve, Offset=-1)
item_6 = ListItem(List=sort_2.ValuesA, Index=mindex_2.Index, Wrap=True)
alongcrv = SortAlongCurve(Points=item_6, Curve=item_4)  # -> Points, Indices

item_7 = ListItem(List=pshift, Index=0, Wrap=True)  # -> flatten(Item)
# network surface method2
end = EndPoints(Curve=pshift)  # -> Start, End
alongcrv_2 = SortAlongCurve(Points=end.Start, Curve=reverse(graft(item_7)))  # -> Points, Indices
item_8 = ListItem(List=pshift, Index=alongcrv_2.Indices, Wrap=True)  # -> simplify(Item)
bang = ExplodeTree(Data=item_8)  # -> Branch0, Branch1
netsurf = NetworkSurface(CurvesU=bang.Branch0, CurvesV=bang.Branch1, Continuity=Slider(3, range=0..3))
previewmat_2 = CustomPreviewMaterials(Geometry=netsurf, DiffuseColor=RGB(255, 255, 255))

# ----
# network surface method1
end_2 = EndPoints(Curve=pshift)  # -> Start, End
sort_pt = SortPoints(Points=end_2.Start)  # -> Points, Indices
item_9 = ListItem(List=pshift, Index=sort_pt.Indices, Wrap=True)
bang_2 = ExplodeTree(Data=item_9)  # -> Branch0, Branch1
netsurf_2 = NetworkSurface(CurvesU=bang_2.Branch0, CurvesV=bang_2.Branch1, Continuity=2)
previewmat_3 = CustomPreviewMaterials(Geometry=netsurf_2, DiffuseColor=RGB(255, 255, 255))

# ----
# surface from points method
item_10 = ListItem(List=item_6, Index=alongcrv.Indices, Wrap=True)
lng = ListLength(List=item_10)  # -> flatten(Length)
item_11 = ListItem(List=lng, Index=0, Wrap=True)
srfgrid_4 = SurfaceFromPoints(Points=flatten(item_10), UCount=item_11, Interpolate=Toggle(True))
previewmat_4 = CustomPreviewMaterials(Geometry=srfgrid_4, DiffuseColor=RGB(255, 255, 255))

brep_cp = BrepClosestPoint(Point=flatten(item_10), Brep=srfgrid_4)  # -> Point, Normal, Distance
bnd = Bounds(Numbers=brep_cp.Distance)
panel_3 = Panel(bnd)
mesh_4 = Mesh(<mesh referenced from the Rhino model>)
mesh_5 = Mesh(<mesh referenced from the Rhino model>)
mesh_6 = Mesh(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)
mesh_7 = Mesh(<mesh referenced from the Rhino model>)
bbox_3 = BoundingBox(Content=mesh_7, Plane=PlaneXY(0, 0, 0))  # -> Box, Box_2
c_script = CSharpScript(x=mesh_6, y=Slider(10, range=0..100))  # -> out, A; inputs x: Mesh, y: Int32
# ---------- c_script: C# usings ----------
using System.Linq;
using Rhino.Geometry.Collections;
# ---------- c_script: C# ----------
    var pts = MeshToPoints(x);
    BrepFace srf = CreatePatchPoints(pts, y, y);
    var outline = MeshOutlineToCurve(x);
    Curve[] pulled = Curve.PullToBrepFace(outline, srf, 0.001);
    var splitBreps = srf.Split(pulled, 0.001).Faces;
    A = splitBreps.Last();
# ---------- c_script: C# additional code ----------
  public BrepFace CreatePatchPoints(List<Point3d> pts, int u, int v)
  {
    var geomPts = new List<GeometryBase>();
    foreach (var pt in pts)
    {
      geomPts.Add(new Point(pt));
    }
    return Brep.CreatePatch(geomPts, u, v, 0.001).Faces[0];
  }

  public Curve MeshOutlineToCurve(Mesh mesh)
  {
    if (mesh == null || !mesh.IsValid)
    {
      return null;
    }
    var outlines = mesh.GetNakedEdges();
    if (outlines == null || outlines.Length == 0)
    {
      return null;
    }
    // Convert outlines to curves
    List<Curve> outlineCurves = new List<Curve>();
    foreach (var outline in outlines)
    {
      outlineCurves.Add(outline.ToNurbsCurve());
    }

    return Curve.JoinCurves(outlineCurves)[0];
  }

  public static List<Point3d> MeshToPoints(Mesh mesh)
  {
    if (mesh == null || !mesh.IsValid)
    {
      return null;
    }

    // Extract vertices from the mesh
    List<Point3d> points = new List<Point3d>();
    foreach (var vertex in mesh.Vertices)
    {
      points.Add(vertex);
    }

    return points;
  }
# ---------- end c_script ----------
debrep_2 = DeconstructBrep(Brep=bbox_3.Box)  # -> Faces, Edges, Vertices
number_slider_4 = Slider(72, range=0..100)
srf = Surface(c_script.A)
item_12 = ListItem(List=debrep_2.Faces, Index=Slider(10, range=0..100), Wrap=True)
sdivide_3 = DivideSurface(Surface=item_12, UCount=number_slider_4, VCount=number_slider_4)  # -> Points, Normals, Parameters
Z_3 = UnitZ(Factor=1)
meshray_2 = MeshRay(Mesh=mesh_7, Point=sdivide_3.Points, Direction=Z_3)  # -> flatten(Point), Hit
null = NullItem(Item=meshray_2.Point)  # -> NullFlags, InvalidFlags, Description
panel_4 = Panel(meshray_2.Point)
cull = CullPattern(List=meshray_2.Point, CullPattern=invert(null.NullFlags))
patch = Patch(Points=cull, Spans=Slider(44, range=0..100), Flexibility=1, Trim=True)
