# Grasshopper definition 5 Level-01.gh (Grasshopper 1.0.7)
# plug-ins: ScriptParasite

toggle = BooleanToggle(True)
# 5 Level - 01
number_slider = Slider(10, range=0..10)
rider = RIder(openFile=toggle)  # -> Folder; inputs openFile: Boolean
# ---------- rider: C# usings ----------
using System.IO;
using System.Diagnostics;

public class ScriptUtilities
{
  public static string GetCurrentFolder(GH_Document doc)
  {
    string filePath = doc.FilePath;
    return Path.GetDirectoryName(filePath);
  }

  public static string[] GetCsFiles(string folderPath)
  {
    return Directory.GetFiles(folderPath, "*.cs");
  }

  public static void OpenFileWithRider(string filePath, Action<string> print)
  {
    try
    {
      // Define the path to the JetBrains Rider executable
      string riderPath = @"C:\Program Files\JetBrains\JetBrains Rider 2024.1.4\bin\rider64.exe";

      if (!File.Exists(riderPath))
      {
        print("Rider executable not found at: " + riderPath);
        return;
      }

      // Start the process to open the file with Rider
      ProcessStartInfo startInfo = new ProcessStartInfo
        {
          FileName = riderPath,
          Arguments = "\"" + filePath + "\"", // Enclose in quotes in case of spaces
          UseShellExecute = true
          };
      Process.Start(startInfo);
    }
    catch (Exception ex)
    {
      print("Error opening file with Rider: " + ex.Message);
    }
  }

  public static void RunScript(bool openFile, ref object Here, IGH_Component owner, Action<string> print)
  {
    // Get the current folder path
    GH_Document doc = owner.OnPingDocument();
    string currentFolder = GetCurrentFolder(doc);
    Here = currentFolder;

    // Get .cs files in the current folder
    string[] csFiles = GetCsFiles(currentFolder);
    if (csFiles.Length > 0)
    {
      string csFilePath = csFiles[0];

      if (openFile)
      {
        OpenFileWithRider(csFilePath, print);
      }
    }
    else
    {
      print("No .cs files found in the directory.");
    }
  }
}
# ---------- rider: C# ----------
   ScriptUtilities.RunScript(openFile, ref Folder, Component, Print);
# ---------- end rider ----------
crv = Curve([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])

c_script = CSharpScript(Crv=crv, Dist=number_slider)  # -> Out, A
scriptpar = ScriptParasite(Enable=toggle, Folder=rider)
